% Requirement links of OuterLoop_Control.slx (R2024b)

block :10 implements HighLevelReqs.slreqx#11: HLR_7: Roll Outer Loop Control
block :11 implements HighLevelReqs.slreqx#12: HLR_8: Yaw Rate Outer Loop Control
block :12 implements HighLevelReqs.slreqx#12: HLR_8: Yaw Rate Outer Loop Control
block :5 implements HighLevelReqs.slreqx#10: HLR_6: Pitch Outer Loop Control
block :5 implements HighLevelReqs.slreqx#11: HLR_7: Roll Outer Loop Control
block :5 implements HighLevelReqs.slreqx#12: HLR_8: Yaw Rate Outer Loop Control
block :6 implements HighLevelReqs.slreqx#10: HLR_6: Pitch Outer Loop Control
block :7 implements HighLevelReqs.slreqx#11: HLR_7: Roll Outer Loop Control
block :8 implements HighLevelReqs.slreqx#10: HLR_6: Pitch Outer Loop Control
block :8 implements HighLevelReqs.slreqx#11: HLR_7: Roll Outer Loop Control
block :8 implements HighLevelReqs.slreqx#12: HLR_8: Yaw Rate Outer Loop Control
block :9 implements HighLevelReqs.slreqx#10: HLR_6: Pitch Outer Loop Control