% Simulink data dictionary DD_OuterLoop_Control.sldd
% references csSingleInstance.sldd

thetaKp = Simulink.Parameter(1.04, DataType="double")  % Proportional gain for pitch control
thetaKi = Simulink.Parameter(2.07, DataType="double")  % Integral gain for pitch control
phiKp = Simulink.Parameter(-0.0991, DataType="double")  % Proportional gain for roll control
phiKi = Simulink.Parameter(-1.35, DataType="double")  % Integral gain for roll control
rKp = Simulink.Parameter(0.137, DataType="double")  % Proportional gain for yaw rate control
rKi = Simulink.Parameter(-2.2, DataType="double")  % Integral gain for yaw rate control